# Grasshopper definition definition.ghx (Grasshopper 1.0.8)
# plug-ins: ReBear
# Esempio ReBear; leggere README.md.

cs = CoordinateSystem(Name="Global XY", Origin=Point(0, 0, 0), P1=Point(1, 0, 0), P2=Point(0, 1, 0))
# ReBear — esempio svolto: Inviluppo con combinazioni concomitanti
# Geometria: mm; forze: kN; momenti: kNm; compressione negativa.
# Dati a sinistra, verifiche e risultati verso destra.
# Dati persistenti nelle porte: tasto destro > Set...
# Consultare README.md e results.json nella stessa cartella.
# Run=True nei componenti di analisi predisposti.
fc = ForceComponent(Name="A", AxialForce=-300, ShearX=60, ShearY=90, Torsion=2, BendingX=45, BendingY=15, CoordinateSystem=cs, Units=1)
fc_2 = ForceComponent(Name="B", AxialForce=-500, ShearX=-80, ShearY=40, Torsion=-4, BendingX=100, BendingY=-25, CoordinateSystem=cs, Units=1)
fc_3 = ForceComponent(Name="C", AxialForce=-100, ShearX=20, ShearY=120, Torsion=7, BendingX=120, BendingY=35, CoordinateSystem=cs, Units=1)
loadenv = LoadEnvelope(Forces=[fc, fc_2, fc_3])  # -> Extremum, Value, CaseIndex, ConcomitantForces
